# Grasshopper definition 01_quarry_to_wall.gh (Grasshopper 1.0.8)
# plug-ins: Frahan StonePack

# README: EX 01 QUARRY TO WALL
# BlockCutOpt: best cutting direction for max whole blocks.
# 1. Adjust Lx/Ly/Lz block-size sliders (m).
# 2. Flip Run=True to solve (brute-force search).
# 3. Panels show recovery % and block count.
# Red mesh = fracture planes inside the bench box.
A = TestedArea({Plane=PlaneXY(0, 0, 0), X=Domain(0, 12), Y=Domain(0, 8), Z=Domain(0, 6)})
F = Fractures(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)
lx = Slider(3, range=1..5)
ly = Slider(2, range=1..4)
lz = Slider(0.8, range=0.3..2)
preview = CustomPreview(Geometry=F, Material=ColourSwatch(SwatchColor=RGB(200, 60, 40)))
run = BooleanToggle(True)
blockcutsolve = BlockCutOptSolve(
    TestedArea=A,
    Fractures=F,
    BlockX=lx,
    BlockY=ly,
    BlockZ=lz,
    Kerf=0.05,
    PsiStepDeg=3,
    DxMax=1.5,
    DxStep=0.5,
    DyMax=1.5,
    DyStep=0.5,
    Run=run)  # -> NonIntersectedCount, Recovery, BestPsiDeg, BestDxM, BestDyM, Evaluations, ElapsedMs
blocks = Panel(blockcutsolve.NonIntersectedCount)
recovery = Panel(blockcutsolve.Recovery)
