# Grasshopper definition 07_scan_ingest_full.gh (Grasshopper 1.0.8)
# plug-ins: Frahan StonePack

# DATA_DRIVE: DATA - download from Google Drive FIRST
# https://drive.google.com/drive/folders/1mDj1Z20BB70SrkjQKnU6O3kDbfuA-mcS?usp=sharing
# 
# LiDAR/TLS:        granite_dells_tls/ot_GD_TLS_data_UTM.laz
# Photogrammetry:  tongjiang/detail_cloudAB.ply
# GPR:               gpr/grimsel/<AU file>.rd3
# Place the file under D:/code_ws/Data/<name>/ (the path this .gh reads),
# then set the file-path input. Datasets finish uploading within ~2h.
# Full list: data/DATA_ACCESS.md
file = File("D:\code_ws\Template-General\raw\2026-05-27\tongjiang\detail_cloudAB.ply")
run = Run(False)
file_2 = File("D:\code_ws\Template-General\raw\2026-05-27\granite_dells_tls\ot_GD_TLS_data_UTM.laz")
run_2 = Run(False)
M = M(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)
M_2 = M(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)
stoneprep = StonePrepScan(Meshes=M, Repair=True, Decimate=False, TargetTriangleCount=0)  # -> CleanedMeshes, Descriptors, MeshVolumes, Compactness, TriangleCounts, Trace, Skipped
scalecal = ScanScaleCalibrate(Meshes=M_2, Units="m")  # -> ScaleTransform, ScaleFactor, MeasuredLength, ScaledMeshes, Report
loadcloud = LoadCloud(FilePath=file, VoxelSize=0.05, Run=run)  # -> Points, InputCount, OutputCount, BoundingBox, Cloud
readlas = ReadLASCloud(FilePath=file_2, VoxelSize=0.05, Run=run_2)  # -> Points, InputCount, OutputCount, BoundingBox, Cloud
M_3 = M([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])
M_4 = M([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])
M_5 = M([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])
C = C(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)
cloudicp = CloudICP(SourceCloud=loadcloud.Points, TargetCloud=readlas.Points, MaxIterations=30, TrimFraction=0.2)  # -> Transform, FinalRMS, Iterations, Converged, Correspondences, Report
packstability = PackedPileStability(PlacedMeshes=M_4, Up=Vector(0, 0, 1), FloorZ=0, ZTolerance=0.001)  # -> Stable, FallingIds, AllStable
packoverlap = PerStoneOverlap(PlacedMeshes=M_3, Tolerance=1e-06)  # -> OverlapFractions, PenetratingIds, MaxOverlap
packcomcheck = CoMInContainerCheck(PlacedMeshes=M_5, Container=C, Tolerance=1e-06)  # -> Inside, CentresOfMass, MarginalIds
mc = Panel(stoneprep.CleanedMeshes)
D = Panel(stoneprep.Descriptors)
X = Panel(cloudicp.Transform)
rms = Panel(cloudicp.FinalRMS)
it = Panel(cloudicp.Iterations)
