# Grasshopper definition uncertainty_safe_yield.gh (Grasshopper 1.0.8)
# plug-ins: Frahan StonePack

# README: EX 09 UNCERTAINTY SAFE YIELD
# GPR fracture surfaces + uncertainty -> safe block yield.
# Solves on internalized data; see README.md for the method.
swatch = ColourSwatch(SwatchColor=RGB(205, 170, 125))
picks = Point([Point(0, 1.015622439, -0.2890625), Point(0, 1.04166404, -0.2890625), Point(0, 1.067705641, -0.2890625), Point(0, 1.093747242, -0.2890625), Point(0, 1.119788843, -0.2890625), Point(0, 1.145830444, -0.2890625)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])
bins = Mesh([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])
gprfrac3d = GPRFractureSurfaces3D(
    FracturePicks=picks,
    NumFractures=-1,
    GridRes=36,
    Velocity=0.1,
    Frequency=600,
    Eps_r=9,
    PermUncertainty=1,
    Tolerance=0.02,
    AssumeOpen=True,
    TimeZero=0,
    DetectBase=0.8,
    ThroughPicks=True,
    PeakDedup=True)  # -> FractureSurfaces, Confidence, MeanSigma, OverallConfidence, Report, Detectability, EffectiveConfidence
overall_confidence = Panel(gprfrac3d.OverallConfidence)
mean_sigma_m = Panel(gprfrac3d.MeanSigma)
fracblockpack = FractureBlockPack(
    ContainerMeshes=bins,
    BlockLength=0.9,
    BlockWidth=0.7,
    BlockHeight=0.4,
    Kerf=0.03,
    FractureClearance=gprfrac3d.MeanSigma,
    Run=True,
    UncertaintySafe=False,
    Packer=4)  # -> Blocks, BinIndex, BlockCount, RecoveredVolume, Yield, Report, SawPasses
preview = CustomPreview(Geometry=fracblockpack.Blocks, Material=swatch)
block_pack_report = Panel(fracblockpack.Report)
