# Grasshopper definition 10_pack2d_nfp_nest.gh (Grasshopper 1.0.8)
# plug-ins: Frahan StonePack

# ---- group: Frahan 2D Irregular Nesting | V506 (exact-NFP BLF, Burke 2006)
sheetw = Slider(3.2, range=0..5)
sheeth = Slider(2, range=0..5)
spacing = Slider(0.005, range=0..0.05)
# README: EX 10 PACK 2D (FLAGSHIP)
# Sheet Nest (Hole-Aware): exact NFP nesting, 0 overlap.
# UNITS: METRES (3.2 x 2.0 m slab). Parts internalized.
# Colours per part; utilization in the panel.
xy = XYPlane(Origin=Point(0, 0, 0))
toggle = BooleanToggle(True)

# ---- group: Frahan 2D Nesting | Sheet Nest (Hole-Aware)
rectangle = Rectangle(Plane=xy, XSize=sheetw, YSize=sheeth, Radius=0)  # -> Rectangle, Length
holenest = SheetNestHoleAware(
    Sheets=rectangle.Rectangle,
    Parts=[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],
    Spacing=spacing,
    BaseRotations=[4, 4],
    ContactRotations=[6, 4],
    Resolution=24,
    MultiStart=4)  # -> Placed, Source, Transform, Nested, Report, Density, Valid, PlacedHoles, Sheet
preview = CustomPreview(Geometry=[holenest.Placed, rectangle.Rectangle], Material=ColourSwatch(SwatchColor=RGB(186, 170, 144)))
