# Grasshopper definition 11_pack3d_block_pack.gh (Grasshopper 1.0.8)
# plug-ins: Frahan StonePack

# ---- group: Frahan 3D Packing | Block Pack (Tree) - Kim 2025 guillotine, saw-cuttable
elemcount = Slider(12, range=4..40)
elemx0 = Slider(3.5, range=2..10)
elemxstep = Slider(0.35, range=0..2)
elemy0 = Slider(7, range=2..15)
elemystep = Slider(-0.15, range=-2..2)
elemz = Slider(4, range=1..15)
contx = Slider(20, range=20..120)
conty = Slider(20, range=20..120)
contz = Slider(8, range=5..120)
rotmode = Slider(2, range=0..2)
forests = Slider(400, range=1..2000)
seed = Slider(0, range=0..100)
kerf = Slider(0, range=0..10)
contprice = Slider(100, range=1..1000)
zero = Slider(0, range=0..1)
xy = XYPlane(Origin=Point(0, 0, 0))
series = Series(Start=elemx0, Step=elemxstep, Count=elemcount)
series_2 = Series(Start=elemy0, Step=elemystep, Count=elemcount)
box = CenterBox(Base=xy, X=series, Y=series_2, Z=elemz)
box_2 = CenterBox(Base=xy, X=contx, Y=conty, Z=contz)
blockpacktree = BlockPackTree(
    Elements=box,
    ElementValues=series,
    Containers=box_2,
    ContainerPrices=contprice,
    RotationMode=rotmode,
    Forests=forests,
    Seed=seed,
    KerfWidth=kerf,
    CutSurfaceWeight=zero,
    MaxParallelism=zero,
    MemoryBudgetMB=zero)  # -> PlacedBoxes, Transforms, PlacedElementIds, PlacedContainerIds, UsedContainers, Score, AllPacked, BestForest, Report
panel = Panel(blockpacktree.Report)
