# Grasshopper definition 13_surface_segment.gh (Grasshopper 1.0.8)
# plug-ins: Frahan StonePack

# ---- group: Frahan Surfaces | Twisted block -> CGAL split by dihedral angle -> 6 surface regions
angle = Slider(35, range=15..90)
segmentanglecgal = MeshSegmentationByAngleCGAL(Mesh=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, Angle=angle, Run=Toggle(True))  # -> Segments, SegmentCount, Available, Report
panel = Panel(segmentanglecgal.Report)

# ----
preview = CustomPreview(Geometry=segmentanglecgal.Segments, Material=ColourSwatch(SwatchColor=RGB(186, 170, 144)))
