# Grasshopper definition 14_kintsugi_bb_parity.gh (Grasshopper 1.0.8)
# plug-ins: Frahan StonePack

# ---- group: Frahan Kintsugi | Breaking Bad parity data, Port mode (verifier 0.71 STRONG)
toggle = BooleanToggle(True)
bbload = LoadBBSample(SampleFile="D:\frahan-stonepack\examples\14_kintsugi\data\bb_sample_00697.bin", MeshStyle=1, Run=toggle)  # -> FragmentPoints, Fragments, FragmentCount, Report
kintsugi = FrahanKintsugi(
    Fragments=bbload.Fragments,
    JointWidth=1,
    SampleSpacing=1,
    BreakAngleDeg=8,
    MinSegmentLength=1,
    BeamWidth=32,
    MaxIterations=100,
    MinLoopLength=10,
    MaxRounds=6,
    VerifierPenetrationTol=0.5,
    DiffusionSteps=20,
    UsePortMode=True,
    Run=toggle,
    UseTorchSharp=False,
    PointClouds=bbload.FragmentPoints,
    VerifierAcceptThreshold=0.5,
    NonCrossing=False)  # -> AssembledFragments, Transforms, PlacedIndices, UnplacedIndices, Residuals, TotalResidual, RimPolylines, Report
panel = Panel(kintsugi.Report)
