# Grasshopper definition 19_rubble_evolved_fit.gh (Grasshopper 1.0.8)
# plug-ins: Frahan RubblePack

blocks = Mesh([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])
stones = Mesh([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])
run = BooleanToggle(True)
rubblefit = RubbleEvolvedFit(Blocks=blocks, Stones=stones, Candidates=12, Seed=12345, Run=run)  # -> Placed, StoneIndex, Yield, Report
