# Grasshopper definition 20_rubble_multibin.gh (Grasshopper 1.0.8)
# plug-ins: Frahan RubblePack

blocks = Mesh([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])
stones = Mesh([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])
run = BooleanToggle(True)
rubblebinpack = RubbleMultiBinPack(Blocks=blocks, Stones=stones, VoxelSize=0.04, Kerf=0.005, Run=run)  # -> Placed, BinIndex, BinFill, Report
