# Grasshopper definition 27_01_three_band_wall.gh (Grasshopper 1.0.8)
# plug-ins: Frahan StonePack

chains = Chains([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])
wall = Wall({Plane=PlaneXY(0, 0, 0), Size=Domain2(u=0..4, v=0..4)})
polymasonryseq = PolygonalMasonrySequence(Chains=chains, Wall=wall, Epsilon=1e-07)  # -> Stones, InstallOrder, Depth, DAGEdges, RegionCount
preview = CustomPreview(Geometry=polymasonryseq.Stones, Material=ColourSwatch(SwatchColor=RGB(196, 183, 160)))
_01_three_band_wall_install_order = Panel(polymasonryseq.InstallOrder)
