# Grasshopper definition 27_04_wall_with_holes.gh (Grasshopper 1.0.8)
# plug-ins: Frahan StonePack

hole_probes = HoleProbes([Point(8, 2, 0), Point(10.5, 2, 0)])
chains = Chains([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])
wall = Wall({Plane=PlaneXY(0, 0, 0), Size=Domain2(u=0..12, v=0..6)})
polymasonryseq = PolygonalMasonrySequence(Chains=chains, Wall=wall, HoleProbes=hole_probes, Epsilon=1e-07)  # -> Stones, InstallOrder, Depth, DAGEdges, RegionCount
preview = CustomPreview(Geometry=polymasonryseq.Stones, Material=ColourSwatch(SwatchColor=RGB(196, 183, 160)))
_04_wall_with_holes_install_order = Panel(polymasonryseq.InstallOrder)
