# Grasshopper definition 27_08_negative_cases.gh (Grasshopper 1.0.8)
# plug-ins: Frahan StonePack

chains = Chains(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)
wall = Wall({Plane=PlaneXY(0, 0, 0), Size=Domain2(u=0..10, v=0..8)})
chains_2 = Chains([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])
wall_2 = Wall({Plane=PlaneXY(0, 0, 0), Size=Domain2(u=12..22, v=0..8)})
polymasonryseq = PolygonalMasonrySequence(Chains=chains, Wall=wall, Epsilon=1e-07)  # -> Stones, InstallOrder, Depth, DAGEdges, RegionCount
polymasonryseq_2 = PolygonalMasonrySequence(Chains=chains_2, Wall=wall_2, Epsilon=1e-07)  # -> Stones, InstallOrder, Depth, DAGEdges, RegionCount
