# Grasshopper definition 36_structural_stone_facade.gh (Grasshopper 1.0.8)
# plug-ins: Frahan StonePack

mesh = Mesh([<mesh referenced from the Rhino model> x46])
masblk = MasonryBlock(Mesh=mesh, Density=2400)  # -> Block, Id
rautoif = RobustAutoInterfaces(Meshes=mesh, BlockIds=masblk.Id, DistanceTolerance=0.001, AngleToleranceDeg=5, MinContactPoints=3)  # -> Interfaces, Count
masasm = MasonryAssembly(Blocks=masblk.Block, Interfaces=rautoif.Interfaces)
masonstable = MasonryStabilityCheck(Stones=mesh, Mu=0.6, Faces=8, FixBelowZ=0.001, Density=2650, ContactTol=0.005, AngleTol=5, CRA=True)  # -> Stable, Report, Utilization
buildord = BlockBuildOrder(Assembly=masasm, UpVector=Vector(0, 0, 1), UpToleranceDeg=30)  # -> OrderedBlockIds, OrderedMeshes, OrderIndex, Layer
