# Grasshopper definition block_to_cladding_panels.gh (Grasshopper 1.0.8)
# plug-ins: Frahan StonePack

slab_sheet = SlabSheet(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)
cladding_panels = CladdingPanels([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])
grout = Grout(0.005)
holenest = SheetNestHoleAware(
    Sheets=slab_sheet,
    Parts=cladding_panels,
    Spacing=grout,
    BaseRotations=4,
    ContactRotations=6,
    Resolution=24,
    MultiStart=4)  # -> Placed, Source, Transform, Nested, Report, Density, Valid, PlacedHoles, Sheet
