# Grasshopper definition concave_nest.gh (Grasshopper 1.0.8)
# plug-ins: Frahan StonePack

sheet_concave_offcut = Sheet(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)
concave_parts = Parts([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])
spacing = Spacing(0.02)
holenest = SheetNestHoleAware(
    Sheets=sheet_concave_offcut,
    Parts=concave_parts,
    Spacing=spacing,
    BaseRotations=4,
    ContactRotations=6,
    Resolution=24,
    MultiStart=4)  # -> Placed, Source, Transform, Nested, Report, Density, Valid, PlacedHoles, Sheet
preview = CustomPreview(Geometry=holenest.Placed, Material=ColourSwatch(SwatchColor=RGB(150, 190, 150)))
