# Grasshopper definition wholeside_reassembly.gh (Grasshopper 1.0.8)
# plug-ins: Frahan StonePack

anchor = Curve(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)
parts = Curve([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])
run = BooleanToggle(True)
wsassemble = WholeSideAssemble(Anchor=anchor, Parts=parts, FitGate=2.5, Run=run)  # -> Placed, Transforms, Ids, TotalResidual, Report
