# Grasshopper definition block_matching_3d.gh (Grasshopper 1.0.8)
# plug-ins: Frahan StonePack

scattered_fragment = ScatteredFragment(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)
anchor_fragment = AnchorFragment(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)
merge = Merge(Data1=anchor_fragment, Data2=scattered_fragment)
preview = CustomPreview(
    Geometry=anchor_fragment,
    Material={diffuse=RGB(120, 138, 155), emission=RGB(0, 0, 0), shine=0, specular=RGB(255, 255, 255), transparency=0.45})
preview_2 = CustomPreview(
    Geometry=scattered_fragment,
    Material={diffuse=RGB(196, 168, 118), emission=RGB(0, 0, 0), shine=0, specular=RGB(255, 255, 255), transparency=0})
softicp3d = SoftICP3D(
    Fragments=flatten(merge),
    AnchorIndex=[0, 0],
    Tau0Factor=[4, 3.5],
    TauAnneal=[0.8, 0.85],
    OutlierWeight=[0.01, 1],
    MaxIterations=[40, 120],
    SampleSpacing=[1, 0.03])  # -> Delta, RefinedFragments, MeanRimGap, MaxPenetration, ContactSamples, Iterations, Remarks
branch = TreeBranch(Tree=softicp3d.RefinedFragments, Path="{0;0}", MaintainPaths=True)
move = Move(Geometry=branch, Motion=[Vector(0, 0, 10), Vector(2.4, 0, 0)])  # -> Geometry, Transform
preview_3 = CustomPreview(
    Geometry=move.Geometry,
    Material={diffuse=RGB(56, 142, 90), emission=RGB(0, 0, 0), shine=0, specular=RGB(255, 255, 255), transparency=0})
